% Simulink data dictionary asbCubeSatModelData.sldd

CubeSatTimeStep = 1
visOff = Simulink.Variant(Condition="variantVisualization == 0")
visSL3D = Simulink.Variant(Condition="variantVisualization == 1")
variantVisualization = 1

StatesOutBus = Simulink.Bus()
  utc_JD: double
  X_ecef: double[3]
  V_ecef: double[3]
  X_eci: double[3]
  V_eci: double[3]
  q_ecef2b: double[4]
  q_eci2b: double[4]
  Euler: double[3]
  LatLonAlt: double[3]
  SunAngle: double
  SunInView: boolean

ACSOutBus = Simulink.Bus()
  AttitudeError: AttitudeErrorBus
  TorqueCmds: double[3]
  cmd_q_b2tgt: double[4]
  NavMode: double

FCSOutBus = Simulink.Bus()
  ACSOut: ACSOutBus

AttitudeErrorBus = Simulink.Bus()
  Roll: double
  Pitch: double
  Yaw: double

EnvBus = Simulink.Bus()
  envAccel_ecef: double[3]
  envForces_body: double[3]
  envTorques_body: double[3]
  x_sun_eci: double[3]
  earthAngRate: double[3]

gains = struct(Kp=5.5e-5, Ki=0, Kd=0.017)
vehicle = struct(mass=3, inertia=[0.025 0 0; 0 0.025 0; 0 0 0.005])

initCond = struct(
  simStartDate=struct(JD=2458488, dateVector=[2019 1 4 12 0 0]),
  CoordEpoch=struct(JD=2451545, dateVector=[2000 1 1 12 0 0]),
  OrbitalElements=struct(
    semiMajorAxis=6771000,
    eccentricity=0.0010537,
    inclination=51.7519,
    RAAN=95.2562,
    argumentOfPerigee=93.4872,
    trueAnomoly=302.9234,
    trueLongitude=0,
    argumentOfLatititude=0,
    longitudeOfPerigee=0),
  r_eci=[-2975091 5195368 3154498],
  v_eci=[-3388.288 -4893.255 4848.906],
  r_ecef=[-5749715 -1678927 3148944],
  v_ecef=[3837.292 -4030.842 4842.87],
  lla=[27.88114 -163.7221 393627.3],
  v_ned=[5474.888 4944.839 -7.503317],
  uvw=[6208.202 2901.044 -2732.775],
  euler=[33.9 -5.91 9.88],
  pqr=[10 -10 5])